# Grasshopper definition sample.gh (Grasshopper 0.9.76)
# plug-ins: PathTool

pathtool = PathTool(RelPath="..\..\test.txt")
pathtool_2 = PathTool(RelPath="..\data\test.txt")
pathtool_3 = PathTool(RelPath="test.txt")
pathtool_4 = PathTool(RelPath="data\test.txt")
panel = Panel(pathtool)
panel_2 = Panel(pathtool_2)
panel_3 = Panel(pathtool_3)
panel_4 = Panel(pathtool_4)
